# Grasshopper definition bc_gh_c.gh (Grasshopper 0.9.76)
# plug-ins: Python Interpreter, Tree8

# ---- group: failed-ibm
node_server = PythonScript()  # -> out, a
# ---------- node_server: Python ----------
#IBM implementation - node server.
from hashlib import sha256
import json
import time


class Block:
    def __init__(self, index, transactions, timestamp, previous_hash):
        self.index = index
        self.transactions = transactions
        self.timestamp = timestamp
        self.previous_hash = previous_hash
        self.nonce = 0

    def compute_hash(self):
        """
        A function that return the hash of the block contents.
        """
        block_string = json.dumps(self.__dict__, sort_keys=True)
        return sha256(block_string.encode()).hexdigest()


class Blockchain:
    # difficulty of our PoW algorithm
    difficulty = 2

    def __init__(self):
        self.unconfirmed_transactions = []
        self.chain = []
        self.create_genesis_block()

    def create_genesis_block(self):
        """
        A function to generate genesis block and appends it to
        the chain. The block has index 0, previous_hash as 0, and
        a valid hash.
        """
        genesis_block = Block(0, [], time.time(), "0")
        genesis_block.hash = genesis_block.compute_hash()
        self.chain.append(genesis_block)

    @property
    def last_block(self):
        return self.chain[-1]

    def add_block(self, block, proof):
        """
        A function that adds the block to the chain after verification.
        Verification includes:
        * Checking if the proof is valid.
        * The previous_hash referred in the block and the hash of latest block
          in the chain match.
        """
        previous_hash = self.last_block.hash

        if previous_hash != block.previous_hash:
            return False

        if not self.is_valid_proof(block, proof):
            return False

        block.hash = proof
        self.chain.append(block)
        return True

    def is_valid_proof(self, block, block_hash):
        """
        Check if block_hash is valid hash of block and satisfies
        the difficulty criteria.
        """
        return (block_hash.startswith('0' * Blockchain.difficulty) and
                block_hash == block.compute_hash())

    def proof_of_work(self, block):
        """
        Function that tries different values of nonce to get a hash
        that satisfies our difficulty criteria.
        """
        block.nonce = 0

        computed_hash = block.compute_hash()
        while not computed_hash.startswith('0' * Blockchain.difficulty):
            block.nonce += 1
            computed_hash = block.compute_hash()

        return computed_hash

    def add_new_transaction(self, transaction):
        self.unconfirmed_transactions.append(transaction)

    def mine(self):
        """
        This function serves as an interface to add the pending
        transactions to the blockchain by adding them to the block
        and figuring out Proof Of Work.
        """
        if not self.unconfirmed_transactions:
            return False

        last_block = self.last_block

        new_block = Block(index=last_block.index + 1,
                          transactions=self.unconfirmed_transactions,
                          timestamp=time.time(),
                          previous_hash=last_block.hash)

        proof = self.proof_of_work(new_block)
        self.add_block(new_block, proof)

        self.unconfirmed_transactions = []
        return new_block.index
# ---------- end node_server ----------
server_and_interface = PythonScript()  # -> out, a
# ---------- server_and_interface: Python ----------
from hashlib import sha256
import json
import time

from flask import Flask, request
import requests


class Block:
    def __init__(self, index, transactions, timestamp, previous_hash):
        self.index = index
        self.transactions = transactions
        self.timestamp = timestamp
        self.previous_hash = previous_hash
        self.nonce = 0

    def compute_hash(self):
        """
        A function that return the hash of the block contents.
        """
        block_string = json.dumps(self.__dict__, sort_keys=True)
        return sha256(block_string.encode()).hexdigest()


class Blockchain:
    # difficulty of our PoW algorithm
    difficulty = 2

    def __init__(self):
        self.unconfirmed_transactions = []
        self.chain = []
        self.create_genesis_block()

    def create_genesis_block(self):
        """
        A function to generate genesis block and appends it to
        the chain. The block has index 0, previous_hash as 0, and
        a valid hash.
        """
        genesis_block = Block(0, [], time.time(), "0")
        genesis_block.hash = genesis_block.compute_hash()
        self.chain.append(genesis_block)

    @property
    def last_block(self):
        return self.chain[-1]

    def add_block(self, block, proof):
        """
        A function that adds the block to the chain after verification.
        Verification includes:
        * Checking if the proof is valid.
        * The previous_hash referred in the block and the hash of latest block
          in the chain match.
        """
        previous_hash = self.last_block.hash

        if previous_hash != block.previous_hash:
            return False

        if not self.is_valid_proof(block, proof):
            return False

        block.hash = proof
        self.chain.append(block)
        return True

    def is_valid_proof(self, block, block_hash):
        """
        Check if block_hash is valid hash of block and satisfies
        the difficulty criteria.
        """
        return (block_hash.startswith('0' * Blockchain.difficulty) and
                block_hash == block.compute_hash())

    def proof_of_work(self, block):
        """
        Function that tries different values of nonce to get a hash
        that satisfies our difficulty criteria.
        """
        block.nonce = 0

        computed_hash = block.compute_hash()
        while not computed_hash.startswith('0' * Blockchain.difficulty):
            block.nonce += 1
            computed_hash = block.compute_hash()

        return computed_hash

    def add_new_transaction(self, transaction):
        self.unconfirmed_transactions.append(transaction)

    def mine(self):
        """
        This function serves as an interface to add the pending
        transactions to the blockchain by adding them to the block
        and figuring out Proof Of Work.
        """
        if not self.unconfirmed_transactions:
            return False

        last_block = self.last_block

        new_block = Block(index=last_block.index + 1,
                          transactions=self.unconfirmed_transactions,
                          timestamp=time.time(),
                          previous_hash=last_block.hash)

        proof = self.proof_of_work(new_block)
        self.add_block(new_block, proof)

        self.unconfirmed_transactions = []
        return new_block.index


app = Flask(__name__)

# the node's copy of blockchain
blockchain = Blockchain()

# the address to other participating members of the network
peers = set()


# endpoint to submit a new transaction. This will be used by
# our application to add new data (posts) to the blockchain
@app.route('/new_transaction', methods=['POST'])
def new_transaction():
    tx_data = request.get_json()
    required_fields = ["author", "content"]

    for field in required_fields:
        if not tx_data.get(field):
            return "Invlaid transaction data", 404

    tx_data["timestamp"] = time.time()

    blockchain.add_new_transaction(tx_data)

    return "Success", 201


# endpoint to return the node's copy of the chain.
# Our application will be using this endpoint to query
# all the posts to display.
@app.route('/chain', methods=['GET'])
def get_chain():
    chain_data = []
    for block in blockchain.chain:
        chain_data.append(block.__dict__)
    return json.dumps({"length": len(chain_data),
                       "chain": chain_data})


# endpoint to request the node to mine the unconfirmed
# transactions (if any). We'll be using it to initiate
# a command to mine from our application itself.
@app.route('/mine', methods=['GET'])
def mine_unconfirmed_transactions():
    result = blockchain.mine()
    if not result:
        return "No transactions to mine"
    return "Block #{} is mined.".format(result)


# endpoint to add new peers to the network.
@app.route('/add_nodes', methods=['POST'])
def register_new_peers():
    nodes = request.get_json()
    if not nodes:
        return "Invalid data", 400
    for node in nodes:
        peers.add(node)

    return "Success", 201


# endpoint to add a block mined by someone else to
# the node's chain. The block is first verified by the node
# and then added to the chain.
@app.route('/add_block', methods=['POST'])
def validate_and_add_block():
    block_data = request.get_json()
    block = Block(block_data["index"],
                  block_data["transactions"],
                  block_data["timestamp",
                  block_data["previous_hash"]])

    proof = block_data['hash']
    added = blockchain.add_block(block, proof)

    if not added:
        return "The block was discarded by the node", 400

    return "Block added to the chain", 201


# endpoint to query unconfirmed transactions
@app.route('/pending_tx')
def get_pending_tx():
    return json.dumps(blockchain.unconfirmed_transactions)


def consensus():
    """
    Our simple consnsus algorithm. If a longer valid chain is
    found, our chain is replaced with it.
    """
    global blockchain

    longest_chain = None
    current_len = len(blockchain)

    for node in peers:
        response = requests.get('http://{}/chain'.format(node))
        length = response.json()['length']
        chain = response.json()['chain']
        if length > current_len and blockchain.check_chain_validity(chain):
            current_len = length
            longest_chain = chain

    if longest_chain:
        blockchain = longest_chain
        return True

    return False


def announce_new_block(block):
    """
    A function to announce to the network once a block has been mined.
    Other blocks can simply verify the proof of work and add it to their
    respective chains.
    """
    for peer in peers:
        url = "http://{}/add_block".format(peer)
        requests.post(url, data=json.dumps(block.__dict__, sort_keys=True))


app.run(debug=True, port=8000)
# ---------- end server_and_interface ----------
python = PythonScript()  # -> out, a
# ---------- python: Python ----------
class Blockchain:
    # difficulty of our PoW algorithm
    difficulty = 2

    def __init__(self):
        self.unconfirmed_transactions = []
        self.chain = []
        self.create_genesis_block()

    def create_genesis_block(self):
        """
        A function to generate genesis block and appends it to
        the chain. The block has index 0, previous_hash as 0, and
        a valid hash.
        """
        genesis_block = Block(0, [], time.time(), "0")
        genesis_block.hash = genesis_block.compute_hash()
        self.chain.append(genesis_block)

    @property
    def last_block(self):
        return self.chain[-1]

    def add_block(self, block, proof):
        """
        A function that adds the block to the chain after verification.
        Verification includes:
        * Checking if the proof is valid.
        * The previous_hash referred in the block and the hash of latest block
          in the chain match.
        """
        previous_hash = self.last_block.hash

        if previous_hash != block.previous_hash:
            return False #find a way to extract these to Gh

        if not self.is_valid_proof(block, proof):
            return False #find a way to extract these to Gh

        block.hash = proof
        self.chain.append(block)
        return True

    def is_valid_proof(self, block, block_hash):
        """
        Check if block_hash is valid hash of block and satisfies
        the difficulty criteria.
        """
        return (block_hash.startswith('0' * Blockchain.difficulty) and
                block_hash == block.compute_hash())

    def proof_of_work(self, block):
        """
        Function that tries different values of nonce to get a hash
        that satisfies our difficulty criteria.
        """
        block.nonce = 0

        computed_hash = block.compute_hash()
        while not computed_hash.startswith('0' * Blockchain.difficulty):
            block.nonce += 1
            computed_hash = block.compute_hash()

        return computed_hash

    def add_new_transaction(self, transaction):
        self.unconfirmed_transactions.append(transaction)

    def mine(self):
        """
        This function serves as an interface to add the pending
        transactions to the blockchain by adding them to the block
        and figuring out Proof Of Work.
        """
        if not self.unconfirmed_transactions:
            return False #find a way to extract these to Gh

        last_block = self.last_block

        new_block = Block(index=last_block.index + 1,
                          transactions=self.unconfirmed_transactions,
                          timestamp=time.time(),
                          previous_hash=last_block.hash)

        proof = self.proof_of_work(new_block)
        self.add_block(new_block, proof)

        self.unconfirmed_transactions = []
        return new_block.index
# ---------- end python ----------
python_2 = PythonScript()  # -> out, a
# ---------- python_2: Python ----------
if x:
        a = "Hello World!"
# ---------- end python_2 ----------

# ----
# two circles get analysed into points, then the points get created into sets and the sets get compared. the difference is encoded into a string and fed into the blockchain.
circle = Circle({Plane=Plane(origin=(4.400722378, -3.577368991, 0), x=(-1, -1.149976157e-10, 0), y=(1.149976157e-10, -1, 0)), Radius=14.1819663})
circle_2 = Circle({Plane=Plane(origin=(-26.93439174, -5.385117972, 0), x=(1, 1.049190338e-10, 0), y=(-1.049190338e-10, 1, 0)), Radius=14.1819663})
cp = ControlPoints(Curve=circle_2)  # -> Points, Weights, Knots
cp_2 = ControlPoints(Curve=circle)  # -> Points, Weights, Knots
create_set_a = CreateSet(List=cp_2.Points)  # -> Set, Map
create_set_a_2 = CreateSet(List=cp_2.Weights)  # -> Set, Map
create_set_b = CreateSet(List=cp.Points)  # -> Set, Map
create_set_b_2 = CreateSet(List=cp.Weights)  # -> Set, Map
difference = SetDifference(SetA=create_set_a.Set, SetB=create_set_b.Set)
difference_2 = SetDifference(SetA=create_set_a_2.Set, SetB=create_set_b_2.Set)
reldif = RelativeDifferences(Values=difference)
panel = Panel(create_set_b.Set)
panel_2 = Panel(reldif)
panel_3 = Panel(create_set_a.Set)
panel_4 = Panel(difference_2)
number_slider = Slider(6, range=0..10)

# ---- group: Computing the relative difference of DATA
reldif_2 = RelativeDifferences(Values=[Slider(73, range=0..100), Slider(35, range=0..100)])

# ----
series = Series(Start=0, Step=Slider(6, range=0..10), Count=number_slider)
txt = Text(panel_2)
item = ListItem(List=reldif_2, Index=1, Wrap=True)
rec = DataRecorder(series, DataLimit=-10, RecordData=True)
number_of_blocks_in_the_blockchain = Slider(4, range=0..100)

panel_5 = Panel(item)

allocn = DataAllocationN(Data=rec, NumberOfItems=number_slider)
txt_2 = Text(panel_5)
mystring = X(txt_2)
python_3 = PythonScript(String=txt_2, nb=number_of_blocks_in_the_blockchain, diff=txt)  # -> out, a, b, c; inputs nb: Int32
# ---------- python_3: Python ----------
#if x:
#    a = "Hello World!"

#Apache License // somehow we need to make the 'b' to send in the output. 

from datetime import datetime #Imports the datetime function
import hashlib as hasher # Imports the library that generate the cryptohashes
import string
import os.path
import json


#define the class of the blocks in the blockchain
class Block:
    def __init__(self, index, timestamp, data, previous_hash):
        self.index = index
        self.timestamp = timestamp
        self.data = String #insert data here from grasshopper
        self.previous_hash = previous_hash
        self.hash = self.hash_block()
        
        #define the class of the blocks in the blockchain
        


    def __str__(self):
        return 'Block #{}'.format(self.index)


    def hash_block(self):
        sha = hasher.sha256()
        seq = (str(x) for x in ( #potentialy this is where we need to pass a string? 
               self.index, self.timestamp, self.data, self.previous_hash))
        sha.update(''.join(seq).encode('utf-8'))
        return sha.hexdigest()

#String from Gh is added to the first genesis block of the blockchain.
def make_genesis_block():
    """Make the first block in a block-chain."""
    block = Block(index=0,
                  timestamp=datetime.now(),
                  data= diff,
                  previous_hash="0")
    return block

#this is where we need input from Gh.
def next_block(last_block, data=''):
    """Return next block in a block chain."""
    idx = last_block.index + 1
    block = Block(index=idx,
                  timestamp=datetime.now(),
                  data='{}{}'.format(data, idx),
                  previous_hash=last_block.hash)
    return block

#this is where the problem lies, in creating blocks, in succession. how can we replace this with a mechanism triggered from GH! on a what -if mechanism.
def test_code():
    """Test creating chain of 20 blocks."""
    blockchain = [make_genesis_block()]
    prev_block = blockchain[0]
    for _ in range(0, nb):
        block = next_block(prev_block, data= String) #for each next block, the String is also added and encoded inside each block.
        blockchain.append(block)
        prev_block = block
        print('{} added to blockchain'.format(block))
        print('Hash: {}\n'.format(block.hash))
        
b = next_block
a = String #test that string actually receives a value
c = diff #test that diff actually receives the difference of sets.
#c = make_genesis_block [0]
# run the test code
test_code()
# ---------- end python_3 ----------
panel_6 = Panel(python_3.c)
panel_7 = Panel(python_3.a)
panel_8 = Panel(allocn)
python_4 = PythonScript(x=mystring)  # -> out, a, b, test
# ---------- python_4: Python ----------
from hashlib import sha256
import json
import time


class Block:
    def __init__(self, index, transactions, timestamp, previous_hash):
        self.index = index
        self.transactions = x
        self.timestamp = timestamp
        self.previous_hash = previous_hash
        self.nonce = 0

    def compute_hash(self):
        """
        A function that return the hash of the block contents.
        """
        block_string = json.dumps(self.__dict__, sort_keys=True)
        return sha256(block_string.encode()).hexdigest()


class Blockchain:
    # difficulty of our PoW algorithm
    difficulty = 2

    def __init__(self):
        self.unconfirmed_transactions = []
        self.chain = []
        self.create_genesis_block()

    def create_genesis_block(self):
        """
        A function to generate genesis block and appends it to
        the chain. The block has index 0, previous_hash as 0, and
        a valid hash.
        """
        genesis_block = Block(0, [], time.time(), "0")
        genesis_block.hash = genesis_block.compute_hash()
        self.chain.append(genesis_block)

    @property
    def last_block(self):
        return self.chain[-1]

    def add_block(self, block, proof):
        """
        A function that adds the block to the chain after verification.
        Verification includes:
        * Checking if the proof is valid.
        * The previous_hash referred in the block and the hash of latest block
          in the chain match.
        """
        previous_hash = self.last_block.hash

        if previous_hash != block.previous_hash:
            return False #find a way to extract these to Gh

        if not self.is_valid_proof(block, proof):
            return False #find a way to extract these to Gh
            a = 'False'

        block.hash = proof
        self.chain.append(block)
        return True
        

    def is_valid_proof(self, block, block_hash):
        """
        Check if block_hash is valid hash of block and satisfies
        the difficulty criteria.
        """
        return (block_hash.startswith('0' * Blockchain.difficulty) and
                block_hash == block.compute_hash())

    def proof_of_work(self, block):
        """
        Function that tries different values of nonce to get a hash
        that satisfies our difficulty criteria.
        """
        block.nonce = 0

        computed_hash = block.compute_hash()
        while not computed_hash.startswith('0' * Blockchain.difficulty):
            block.nonce += 1
            computed_hash = block.compute_hash()

        return computed_hash

    def add_new_transaction(self, transaction):
        self.unconfirmed_transactions.append(transaction)

    def mine(self):
        """
        This function serves as an interface to add the pending
        transactions to the blockchain by adding them to the block
        and figuring out Proof Of Work.
        """
        if not self.unconfirmed_transactions:
            return False #find a way to extract these to Gh

        last_block = self.last_block

        new_block = Block(index=last_block.index + 1,
                          transactions=self.unconfirmed_transactions,
                          timestamp=time.time(),
                          previous_hash=last_block.hash)

        proof = self.proof_of_work(new_block)
        self.add_block(new_block, proof)

        self.unconfirmed_transactions = []
        return new_block.index
        
a = Block       
test = x
# ---------- end python_4 ----------
simple_hash = PythonScript(x=txt_2)  # -> out, a
# ---------- simple_hash: Python ----------
from hashlib import sha256
data = x
sha256(data).hexdigest()
a = sha256(data).hexdigest()
# ---------- end simple_hash ----------
panel_9 = Panel(simple_hash.a)
panel_10 = Panel(python_4.a)
panel_11 = Panel(python_4.test)
panel_12 = Panel(python_3.out)
