# Grasshopper definition gHowl_test_UDP.gh (Grasshopper 0.9.76)
# plug-ins: gHowl

netsource = NetworkSource()  # -> NetworkAdapterIsUp, AdapterProperties, LocalIpAddress
panel = Panel(netsource.NetworkAdapterIsUp)
panel_2 = Panel(netsource.LocalIpAddress)
panel_3 = Panel(netsource.AdapterProperties)
number_slider = Slider(7545, range=0..10000)
panel_4 = Panel("type something here")
udp = UDPReceiver(Address="127.0.0.1", Port=number_slider, Pattern=0)  # -> Info, Data
udp_2 = UDPSender(Address="127.0.0.1", Port=number_slider, Pattern=0, Data=panel_4)
panel_5 = Panel(udp_2)
panel_6 = Panel(udp.Data)
